# Grasshopper definition WoodColumnCrossSection.gh (Grasshopper 0.9.76)
# plug-ins: Python Interpreter

width_mm = Panel("""50
38
50
50
75
50
50
63
50
50
100
50
75
75
75
125
75
100
150
100
175
200""")
data = Data(width_mm)
panel = Panel("Savskåret træ")
height_mm = Panel("""50
73
75
100
75
125
150
125
175
200
100
225
150
175
200
125
225
200
150
225
175
200""")
data_2 = Data(height_mm)
area_10_3_mm2 = Panel("""2.5
2.77
3.75
5
5.62
6.25
7.5
7.87
8.75
10
10
11.25
11.25
13.15
15
15.65
16.9
20
22.5
22.5
30.6
40""")
data_3 = Data(area_10_3_mm2)
wy_10_3_mm_3 = Panel("""20.8
33.8
46.9
83.3
70.3
130
187.5
164
255
333
166.5
422
281
383
500
326
633
667
563
844
893
1335""")
data_4 = Data(wy_10_3_mm_3)
wz_10_3_mm_3 = Panel("""20.8
17.57
31.3
41.7
70.3
52.1
62.5
82.7
72.9
83.3
166.5
93.8
140.5
164
187.5
326
211
333
563
375
893
1335""")
data_5 = Data(wz_10_3_mm_3)
iy_10_6_mm_4 = Panel("""0.521
1.232
1.760
4.17
2.64
8.14
14.05
10.25
22.3
33.3
8.33
47.5
21.1
33.5
50
20.3
71.2
66.7
42.2
94.9
78.2
133.5""")
data_6 = Data(iy_10_6_mm_4)
iz_10_6_mm_4 = Panel("""0.521
0.334
0.781
1.04
2.64
1.3
1.56
2.6
1.825
2.08
8.33
2.34
5.27
6.15
7.03
20.3
7.91
16.65
42.2
18.75
78.2
133.5""")
data_7 = Data(iz_10_6_mm_4)
entwine = Entwine(
    Branch00=data,
    Branch01=data_2,
    Branch02=data_3,
    Branch03=data_4,
    Branch04=data_5,
    Branch05=data_6,
    Branch06=data_7,
    FlattenInputs=True)
data_8 = Data(entwine)

# ---- group: TEST FOR CALCULATION OF MOMENT OF INERTIA
number_slider = Slider(93, range=0..1000)  # disabled
number_slider_2 = Slider(39, range=0..100)  # disabled
number_slider_3 = Slider(112, range=0..1000)  # disabled
int = Integer(number_slider)  # disabled
int_2 = Integer(number_slider_3)  # disabled
int_3 = Integer(number_slider_2)  # disabled

# ---- group: Support conditions column
list = ValueList({"Simply supported both ends": 1, "One end fixed and one end not supported": 2, "One end fixed and one end simply supported": 0.699, "Both ends fixed": 1/2}, selected="Simply supported both ends")

# ---- group: Strength class wood
strength_class_for_wood = ValueList({"C30": 30, "C24": 24, "C18": 18, "C14": 14, "GL32": 32, "Gl28": 28, "GL24": 24}, selected="C24")

# ----
# "Calculation of minimum required cross section of wooden columns"
# 
# "2017"
# 
# Created by Mikkel Dohm Andersen
load_in_n = Slider(274, range=0..1000)

# ---- group: TEST FOR CALCULATION OF MOMENT OF INERTIA / Test for case 2*width + height
python = PythonScript(r=int_3, H=int, W=int_2)  # -> out, a; disabled
# ---------- python: Python ----------
import math as m
#Area of 1 corner
Acr = r**2*(1-m.pi/4)
#Moment of inertia corner
Ir = 0.00742*r**4
#Distance to center of gravity corner
sr = 0.223*r
#Width + 2Height 


A=(W*H-Acr)
Sh=(Acr*(H/2-sr))
drh=(Sh/A)
Iysq=(1/12*W*(H-2*drh)**3+1/12*W*(2*drh)**3+W*2*drh*(H/2)**2)
Iycr=(Ir+Acr*((H/2)+drh-sr)**2)
Iytot=(Iysq-Iycr)
Sw=(Acr*(W/2-sr))
drw=(Sw/A)
Izsq=(1/12*H*(W-2*drh)**3+1/12*H*(2*drh)**3+H*2*drh*(W/2)**2)
Iycr=(Ir+Acr*((W/2)+drw-sr)**2)
Iztot=(Izsq-Izcr)
Pr=(H+(H-r)+W+(W-r)+(m.pi*r*2)/4)
Ar=(H*W-Acr)

"""
#NIX PILLE!!!
A=(W*H-2*Acr)
S=(2*Acr*(H/2-sr))
dr=(S/A)
Iysq=(1/12*W*(H-2*dr)**3+1/12*W*(2*dr)**3+W*2*dr*(H/2)**2)
Iycr=(2*Ir+2*Acr*((H/2)+dr-0.223*r)**2)
Iytot=(Iysq-Iycr)
Izsq=((1/12*H*W**3))
Izcr=(2*Ir+2*Acr*((W/2)-0.223*r)**2)
Iztot=(Izsq-Izcr)
Pr=(2*(W-2*r)+(H-2*r)+(H-4*r)+(2*(m.pi*r*2)/4))
Ar=(W*H-2*Acr)
"""
print(Iytot)
print(Iztot)
# ---------- end python ----------

# ----
pt = ConstructPoint(XCoordinate=0, YCoordinate=0, ZCoordinate=0)
pt_2 = ConstructPoint(XCoordinate=0, YCoordinate=0, ZCoordinate=Slider(3000, range=0..10000))
ln = Line(StartPoint=pt, EndPoint=pt_2)
time_of_exposure = Slider(27, range=0..100)

# ---- group: Calculate required moment of inertia python
calculate_required_moment_of_inertia = PythonScript(Ncr=load_in_n, E=strength_class_for_wood, SupCon=list, CL=ln)  # -> out, I
# ---------- calculate_required_moment_of_inertia: Python ----------
import math as m
import rhinoscriptsyntax as rs

ls = rs.CurveLength(CL)*SupCon
I = (m.pow(ls,2)*Ncr)/(m.pow(m.pi,2)*E)
print(I)
# ---------- end calculate_required_moment_of_inertia ----------

# ---- group: Calculate required moment of inertia expression
beregning_af_inertimoment_expression = BeregningAfInertimomentExpression(load=load_in_n, strength_class_wood=strength_class_for_wood, support_conditions=list, centerline_for_column=ln)  # disabled

# ----
time_of_exposure_2 = Data(time_of_exposure)
monodimensional_charring_rates = ValueList({"Conifer with p > 290 kg/m3": 0.65, "Laminated wood with p > 290 kg/m3": 0.65, "Hardwood with p > 450 kg/m3": 0.50, "Plywood with a thickness d > 20 mm and density p > 450 kg/m3": 1}, selected="Conifer with p > 290 kg/m3")
fire_exposed_sides_of_cross_section = ValueList({"Width": 1, "Height": 2, "Width + Height": 3, "Width + 2*Height": 4, "2*Width + Height": 5, "2*Width": 6, "2*Height": 7, "All": 8}, selected="Width + 2*Height")
monodimensional_charring_rates_2 = ValueList({"Conifer with p > 290 kg/m3": 0.65, "Laminated wood with p > 290 kg/m3": 0.65, "Hardwood with p > 450 kg/m3": 0.50, "Plywood with a thickness d > 20 mm and density p > 450 kg/m3": 1}, selected="Conifer with p > 290 kg/m3")
panel_2 = Panel(calculate_required_moment_of_inertia.I)

# ---- group: Wood species charring rate
notional_charring_rates = ValueList({"Conifer with p > 290 kg/m3": 0.8, "Laminated wood with p > 290 kg/m3": 0.7, "Hardwood with p > 450 kg/m3": 0.55}, selected="Conifer with p > 290 kg/m3")

# ---- group: Calculate required moment of inertia components
beregning_af_inertimoment_med_komponente = BeregningAfInertimomentMedKomponenter()  # "Beregning af inertimoment med komponenter"; disabled

# ----
fire_exposed_sides_of_cross_section_2 = ValueList({"Width": 1, "Height": 2, "Width + Height": 3, "Width + 2*Height": 4, "2*Width + Height": 5, "2*Width": 6, "2*Height": 7, "All": 8}, selected="Width + 2*Height")
fire_exposed_sides_of_cross_section_3 = ValueList({"Width": 1, "Height": 2, "Width + Height": 3, "Width + 2*Height": 4, "2*Width + Height": 5, "All": 6, "2*Width": 7, "2*Height": 8}, selected="Width")
time_of_exposure_3 = Slider(12, range=0..100)
time_of_exposure_4 = Data(time_of_exposure)
requried_moment_of_inertia = Data(calculate_required_moment_of_inertia.I)
requried_moment_of_inertia_2 = Data(requried_moment_of_inertia)
requried_moment_of_inertia_3 = Data(requried_moment_of_inertia_2)
type_of_wood = Data(Tree({0;0}: ["50", "38", "50", "50", "75", "50", "50", "63", "50", "50", "100", "50", "75", "75", "75", "125", "75", "100", "150", "100", "175", "200"], {0;1}: ["50", "73", "75", "100", "75", "125", "150", "125", "175", "200", "100", "225", "150", "175", "200", "125", "225", "200", "150", "225", "175", "200"], {0;2}: ["2.5", "2.77", "3.75", "5", "5.62", "6.25", "7.5", "7.87", "8.75", "10", "10", "11.25", "11.25", "13.15", "15", "15.65", "16.9", "20", "22.5", "22.5", "30.6", "40"], {0;3}: ["20.8", "33.8", "46.9", "83.3", "70.3", "130", "187.5", "164", "255", "333", "166.5", "422", "281", "383", "500", "326", "633", "667", "563", "844", "893", "1335"], {0;4}: ["20.8", "17.57", "31.3", "41.7", "70.3", "52.1", "62.5", "82.7", "72.9", "83.3", "166.5", "93.8", "140.5", "164", "187.5", "326", "211", "333", "563", "375", "893", "1335"], {0;5}: ["0.521", "1.232", "1.760", "4.17", "2.64", "8.14", "14.05", "10.25", "22.3", "33.3", "8.33", "47.5", "21.1", "33.5", "50", "20.3", "71.2", "66.7", "42.2", "94.9", "78.2", "133.5"], {0;6}: ["0.521", "0.334", "0.781", "1.04", "2.64", "1.3", "1.56", "2.6", "1.825", "2.08", "8.33", "2.34", "5.27", "6.15", "7.03", "20.3", "7.91", "16.65", "42.2", "18.75", "78.2", "133.5"]))
type_of_wood_2 = Data(type_of_wood)
type_of_wood_3 = Data(type_of_wood_2)
type_of_wood_4 = Data(type_of_wood_3)

# ----
# Deconstruct cross section data
type_of_wood_5 = Data(type_of_wood_2)
flip = FlipMatrix(Data=type_of_wood_5)
item = ListItem(List=flip, Index=0, Wrap=True)  # -> flatten(Item), flatten(Item1), flatten(Item2), flatten(Item3), flatten(Item4), flatten(Item5), flatten(Item6)
width = Data(item.Item)
area = Data(item.Item2)
wy = Data(item.Item3)
wz = Data(item.Item4)
iy = Data(item.Item5)
iz = Data(item.Item6)
height = Data(item.Item1)

# ----
# Deconstruct cross section data
type_of_wood_6 = Data(type_of_wood_4)
flip_2 = FlipMatrix(Data=type_of_wood_6)
item_2 = ListItem(List=flip_2, Index=0, Wrap=True)  # -> flatten(Item), flatten(Item1), flatten(Item2), flatten(Item3), flatten(Item4), flatten(Item5), flatten(Item6)
iy_2 = Data(item_2.Item5)
width_2 = Data(item_2.Item)
area_2 = Data(item_2.Item2)
wy_2 = Data(item_2.Item3)
wz_2 = Data(item_2.Item4)
iz_2 = Data(item_2.Item6)
height_2 = Data(item_2.Item1)

# ----
# Deconstruct cross section data
type_of_wood_7 = Data(type_of_wood_3)
flip_3 = FlipMatrix(Data=type_of_wood_7)
item_3 = ListItem(List=flip_3, Index=0, Wrap=True)  # -> flatten(Item), flatten(Item1), flatten(Item2), flatten(Item3), flatten(Item4), flatten(Item5), flatten(Item6)
area_3 = Data(item_3.Item2)
wy_3 = Data(item_3.Item3)
wz_3 = Data(item_3.Item4)
iy_3 = Data(item_3.Item5)
iz_3 = Data(item_3.Item6)
width_3 = Data(item_3.Item)
height_3 = Data(item_3.Item1)

# ---- group: Smallest profile with enough capacity
requried_moment_of_inertia_4 = Data(requried_moment_of_inertia)
type_of_wood_8 = Data(type_of_wood)

# ---- group: Smallest profile with enough capacity / Cross section dimensions
flip_4 = FlipMatrix(Data=type_of_wood_8)
item_4 = ListItem(List=flip_4, Index=0, Wrap=True)  # -> flatten(Item), flatten(Item1), flatten(Item2), flatten(Item3), flatten(Item4), flatten(Item5), flatten(Item6)
wy_4 = Data(item_4.Item3)
wz_4 = Data(item_4.Item4)
iy_4 = Data(item_4.Item5)
width_4 = Data(item_4.Item)
area_4 = Data(item_4.Item2)
iz_4 = Data(item_4.Item6)
height_4 = Data(item_4.Item1)

# ----
# Standard fire design
# Reduced Cross Section Method
time_of_exposure_5 = Data(time_of_exposure_3)
num = Number(area)
num_2 = Number(width)
num_3 = Number(height)
num_4 = Number(num)

abs = Absolute(Value=time_of_exposure_5)
pyrolysis_zone = PythonScript(t=abs)  # -> out, dpy
# ---------- pyrolysis_zone: Python ----------
if t<20: 
    dpy = 7/20*t 
else:
    dpy = 7

print(dpy)
# ---------- end pyrolysis_zone ----------
panel_3 = Panel("Pyrolysis Zone")
pyrolysis_zone_2 = Data(pyrolysis_zone.dpy)

charring_rate = Data(notional_charring_rates)
panel_4 = Panel("Charring Layer")
expression = Expression(B=charring_rate, t=time_of_exposure_5, Expression="B*t")
charring_layer = Data(expression)

# ----
# Parametric fire design
# Strength reduction method
requried_moment_of_inertia_5 = Data(requried_moment_of_inertia_3)
time_of_exposure_6 = Data(time_of_exposure_2)
opening_factor = Data(Slider(0.04, range=0..0.1))
fire_load_density = Data(Slider(400, range=0..1000))
thermal_inertia = Data(Slider(1160, range=0..10000))
charring_rate_2 = Data(monodimensional_charring_rates)
fire_exposed_sides = Data(fire_exposed_sides_of_cross_section)
time_of_exposure_7 = Data(time_of_exposure_6)

# ---- group: Charring depth in parametric fires
python_2 = PythonScript(t=time_of_exposure_6, O=opening_factor, q=fire_load_density, b=thermal_inertia, B0=charring_rate_2)  # -> out, dchar
# ---------- python_2: Python ----------
t1=0.0145*q/O
BL=1.25-0.035/((1160/b)*O+0.021)
B1=1.5*B0*BL
if t<t1/3:
    dchar=B1*t
elif t1/3<t:
    dchar=B1/(12*t1)*(-9*t**2+18*t1*t-t1**2)
# ---------- end python_2 ----------

# ----
# Standard fire design
# Strength reduction method
charring_rate_3 = Data(monodimensional_charring_rates_2)
time_of_exposure_8 = Data(time_of_exposure_4)
requried_moment_of_inertia_6 = Data(requried_moment_of_inertia_2)
multiplication = Multiplication(A=charring_rate_3, B=time_of_exposure_8)
charring_depth = Data(multiplication)
fire_exposed_sides_2 = Data(fire_exposed_sides_of_cross_section_2)
dchar = Data(charring_depth)
time_of_exposure_9 = Data(time_of_exposure_8)

# ---- group: Check for bmin
python_3 = PythonScript(dchar=charring_depth, z=fire_exposed_sides_of_cross_section_2)  # -> out, bmin
# ---------- python_3: Python ----------
if z==1 or z==2 or z==3 or z==5 or z==6:
    a=1
else:
    a=2

if dchar < 13:
    bmin = 8.15*dchar
else:
    bmin = a*dchar+80

print(bmin)
# ---------- end python_3 ----------

# ---- group: Smallest profile with enough capacity (continued)
iy_5 = Data(iy_4)
iz_5 = Data(iz_4)
python_4 = PythonScript(I=requried_moment_of_inertia_4, Iy=iy_5, Iz=iz_5)  # -> out, PatternY, PatternZ; inputs Iy: list, Iz: list
# ---------- python_4: Python ----------
""" Returns member boolean statement indicating moments of inertia larger than needed

    Args:
        I: Moment of inertia needed
        Iy: Moment of inertia y-axiz
        Iz: Moment of inertia z-axiz
    Returns:
        PatternY: Boolean statement for capacity > needed for y axis
        PatternZ: Boolean statement for capacity > needed for z axis
"""
Y=[]
Z=[]

# Muliplying the list values to match input for Iy
for i in Iy:
    Y.append(i*10**6)
for i in Iz:
    Z.append(i*10**6)
#print (y)

#Empty list for the new values
PatternY=[]
PatternZ=[]
#Creating boolean statement for capacity > needed
for i in Y:
    PatternY.append(i>I)
#print(PatternY)
for i in Z:
    PatternZ.append(i>I)
#print(PatternZ)
str(PatternY)
str(PatternZ)
# ---------- end python_4 ----------
python_5 = PythonScript(x=python_4.PatternY, y=python_4.PatternZ)  # -> out, True, False; inputs x: list, y: list; same code as python_2
cull = CullPattern(List=area_4, CullPattern=python_5.True)
bnd = Bounds(Numbers=cull)
num_5 = Number(area_4)
dedomain = DeconstructDomain(Domain=bnd)  # -> Start, End
mindex = MemberIndex(Set=num_5, Member=dedomain.Start)  # -> Index, Count
num_6 = Number(width_4)
num_7 = Number(height_4)

# ----
num_8 = Number(num_5)
bnd_2 = Bounds(Numbers=mindex.Index)
bnd_3 = Bounds(Numbers=cull)
dedomain_2 = DeconstructDomain(Domain=bnd_2)  # -> Start, End
dedomain_3 = DeconstructDomain(Domain=bnd_3)  # -> Start, End
item_5 = ListItem(List=num_8, Index=dedomain_2.Start, Wrap=True)

# ---- group: Smallest profile with enough capacity (continued)
item_6 = ListItem(List=num_7, Index=dedomain_2.Start, Wrap=True)
item_7 = ListItem(List=num_6, Index=dedomain_2.Start, Wrap=True)
width_5 = Data(item_7)
height_5 = Data(item_6)

# ----
width_6 = Data(width_5)
height_6 = Data(height_5)

addition = Addition(A=charring_layer, B=pyrolysis_zone_2)
carring_layer_pyrolysis_zone = Data(addition)

panel_5 = Panel("Exposed sides")
python_6 = PythonScript(W=width, H=height, d=carring_layer_pyrolysis_zone, z=fire_exposed_sides_of_cross_section_3)  # -> out, Width, Height; inputs W: list, H: list
# ---------- python_6: Python ----------
w=[]
h=[]
for i in range(len(W)):
    if z==1:
        w.append(W[i])
        h.append(H[i]-d)
        #print('z 1')
    elif z==2:
        w.append(W[i]-d)
        h.append(H[i])
        #print('z 2')
    elif z==3:
        w.append(W[i]-d)
        h.append(H[i]-d)
        #print('z 2')
    elif z==4:
        w.append(W[i]-2*d)
        h.append(H[i]-d)
        #print('z 4')
    elif z==5:
        w.append(W[i]-d)
        h.append(H[i]-2*d)
        #print('z 5')
    elif z==6:
        w.append(W[i])
        h.append(H[i]-2*d)
        #print('z 6')
    elif z==7:
        w.append(W[i]-2*d)
        h.append(H[i])
        #print('z 7')
    elif z==8:
        w.append(W[i]-2*d)
        h.append(H[i]-2*d)
        #print('z 8')
Width=w
Height=h
# ---------- end python_6 ----------

# ---- group: Iz
iy_6 = Expression(W=python_6.Width, H=python_6.Height, Expression="1/12*H*W^3")

# ----
panel_6 = Panel(python_6.Width)
iy_7 = Expression(W=python_6.Width, H=python_6.Height, Expression="1/12*W*H^3")
panel_7 = Panel(python_6.Height)
iz_6 = Data(iy_6)
iy_8 = Data(iy_7)
python_7 = PythonScript(I=requried_moment_of_inertia_4, Iy=iy_8, Iz=iz_6)  # -> out, PatternY, PatternZ; inputs Iy: list, Iz: list; same code as python
python_8 = PythonScript(x=python_7.PatternY, y=python_7.PatternZ)  # -> out, True, False; inputs x: list, y: list; same code as python_2
cull_2 = CullPattern(List=area, CullPattern=python_8.True)
bnd_4 = Bounds(Numbers=cull_2)
dedomain_4 = DeconstructDomain(Domain=bnd_4)  # -> Start, End
mindex_2 = MemberIndex(Set=num, Member=dedomain_4.Start)  # -> Index, Count
bnd_5 = Bounds(Numbers=mindex_2.Index)
dedomain_5 = DeconstructDomain(Domain=bnd_5)  # -> Start, End
item_8 = ListItem(List=num_4, Index=dedomain_5.Start, Wrap=True)
item_9 = ListItem(List=num_3, Index=dedomain_5.Start, Wrap=True)
item_10 = ListItem(List=num_2, Index=dedomain_5.Start, Wrap=True)
width_7 = Data(item_10)
height_7 = Data(item_9)
height_8 = Data(height_7)
width_8 = Data(width_7)

cluster = Cluster(
    width_catalog=width,
    height_catalog=height,
    area=area,
    required_moment_of_inertia=requried_moment_of_inertia_4,
    iy=iy_8,
    iz=iz_6)  # -> width_3, height_3

charring_depth_2 = Data(python_2.dchar)
dchar_2 = Data(charring_depth_2)

# ---- group: Check for bmin
python_9 = PythonScript(dchar=charring_depth_2, z=fire_exposed_sides_of_cross_section)  # -> out, bmin; same code as python_3

# ----
larger = LargerThan(FirstNumber=width_2, SecondNumber=python_9.bmin)  # -> LargerThan, OrEqualTo
cull_3 = CullPattern(List=width_2, CullPattern=larger.LargerThan)
cull_4 = CullPattern(List=height_2, CullPattern=larger.LargerThan)
cull_5 = CullPattern(List=area_2, CullPattern=larger.LargerThan)
width_larger_than_bmin = Data(cull_3)
height_larger_than_bmin = Data(cull_4)
area_larger_than_bmin = Data(cull_5)

# ---- group: Generates reduced width and height
# Calculates moment of inertia
python_10 = PythonScript(W=width_larger_than_bmin, H=height_larger_than_bmin, d=dchar_2, z=fire_exposed_sides)  # -> out, Width, Height; inputs W: list, H: list
# ---------- python_10: Python ----------
w=[]
h=[]

for i in range(len(W)):
    if z==1:
        w.append(W[i])
        h.append(H[i]-d)
        #print('z 1')
    elif z==2:
        w.append(W[i]-d)
        h.append(H[i])
        #print('z 2')
    elif z==3:
        w.append(W[i]-d)
        h.append(H[i]-d)
        #print('z 2')
    elif z==4:
        w.append(W[i]-2*d)
        h.append(H[i]-d)
        #print('z 4')
    elif z==5:
        w.append(W[i]-d)
        h.append(H[i]-2*d)
        #print('z 5')
    elif z==6:
        w.append(W[i])
        h.append(H[i]-2*d)
        #print('z 6')
    elif z==7:
        w.append(W[i]-2*d)
        h.append(H[i])
        #print('z 7')
    elif z==8:
        w.append(W[i]-2*d)
        h.append(H[i]-2*d)
        #print('z 8')
Width=w
Height=h
# ---------- end python_10 ----------

# ---- group: Uses reduced widht and height to calculate moment of inertia
python_11 = PythonScript(r=charring_depth_2, W=python_10.Width, H=python_10.Height, z=fire_exposed_sides)  # -> out, Iy, Iz, Pr, Ar; inputs W: list, H: list
# ---------- python_11: Python ----------
import math as m
#Area of 1 corner
Acr = r**2*(1-m.pi/4)
#Moment of inertia corner
Ir = 0.00742*r**4
#Distance to center of gravity corner
sr = 0.223*r

#Lists for calculation
A = []      #Cross section area
S = []      #Static moment about original axis
Sh = []     #Static moment about original axis case 3
Sw = []     #Static moment about original axis case 3
dr = []     #Displacement of axis for corners
Iysq = []   #Moment of inertia around z axis rectangle
Izsq = []   #Moment of inertia around y axis rectangle
Iycr = []   #Moment of inertia corner z axis corner
Izcr = []   #Moment of inertia corner y axis corner
Iytot = []  #Moment of inertia combined z axis total
Iztot = []  #Moment of inertia combined y axis total
Pr = []     #Perimeter
Ar = []     #Area of cross section with rounded corners

#Sides exposed to fire
#Width, Height, 2*Width, 2*Height same calculations
if z==1 or z==2 or z==6 or z== 7:  
    for i in range(len(W)):
        Iytot.append(1/12*W[i]*H[i]**3)
        Iztot.append(1/12*H[i]*W[i]**3)
        Pr.append(2*W[i]+2*H[i])
        Ar.append(W[i]*H[i])
#Width + Height
elif z==3:
    for i in range(len(W)):
        A.append(W[i]*H[i]-Acr)
        Sh.append(Acr*(H[i]/2-sr))
        drh.append(Sh[i]/A[i])
        Iysq.append(1/12*W[i]*(H[i]-2*drh[i])**3+1/12*W[i]*(2*drh[i])**3+W[i]*2*drh[i]*(H[i]/2)**2)
        Iycr.append(Ir+Acr*((H[i]/2)+drh[i]-sr)**2)
        Iytot.append(Iysq[i]-Iycr[i])
        Sw.append(Acr*(W[i]/2-sr))
        drw.append(Sw[i]/A[i])
        Izsq.append(1/12*H[i]*(W[i]-2*drh[i])**3+1/12*H[i]*(2*drh[i])**3+H[i]*2*drh[i]*(W[i]/2)**2)
        Iycr.append(Ir+Acr*((W[i]/2)+drw[i]-sr)**2)
        Iztot.append(Izsq[i]-Izcr[i])
        Pr.append(H[i]+(H[i]-r)+W[i]+(W[i]-r)+(m.pi*r*2)/4)
        Ar.append(H[i]*W[i]-Acr)
#Width + 2*Height 
elif z==4: 
    for i in range(len(W)):
        A.append(W[i]*H[i]-2*Acr)
        S.append(2*Acr*(H[i]/2-sr))
        dr.append(S[i]/A[i])
        Iysq.append(1/12*W[i]*(H[i]-2*dr[i])**3+1/12*W[i]*(2*dr[i])**3+W[i]*2*dr[i]*(H[i]/2)**2)
        Iycr.append(2*Ir+2*Acr*((H[i]/2)+dr[i]-0.223*r)**2)
        Iytot.append(Iysq[i]-Iycr[i])
        Izsq.append((1/12*H[i]*W[i]**3))
        Izcr.append(2*Ir+2*Acr*((W[i]/2)-0.223*r)**2)
        Iztot.append(Izsq[i]-Izcr[i])
        Pr.append((W[i])+2*(H[i]-r)+(W[i]-2*r)+(2*(m.pi*r*2)/4))
        Ar.append(W[i]*H[i]-2*Acr)
#2*Width + Height
elif z==5:
    for i in range(len(W)):
        A.append(H[i]*W[i]-2*Acr)
        S.append(2*Acr*(W[i]/2-sr))
        dr.append(S[i]/A[i])
        Iysq.append(1/12*H[i]*(W[i]-2*dr[i])**3+1/12*H[i]*(2*dr[i])**3+H[i]*2*dr[i]*(W[i]/2)**2)
        Iycr.append(2*Ir+2*Acr*((W[i]/2)+dr[i]-0.223*r)**2)
        Iytot.append(Iysq-Iycr)
        Izsq.append((1/12*W[i]*H[i]**3))
        Izcr.append(2*Ir+2*Acr*((H[i]/2)-0.223*r)**2)
        Iztot.append(Izsq-Izcr)
        Pr.append((H[i]+2*(W[i]-r)+(H[i]-2*r)+(2*(m.pi*r*2)/4)))
        Ar.append(H[i]*W[i]-2*Acr)
#2*Width + 2*Height
elif z==8: 
    for i in range(len(W)):
        Iytot.append(1/12*W[i]*H[i]**3-r**2*(4-m.pi)*(H[i]/2-sr)**2-4*Ir)
        Iztot.append(1/12*H[i]*W[i]**3-r**2*(4-m.pi)*(W[i]/2-sr)**2-4*Ir)
        Pr.append(2*(H[i]-2*r)+2*(W[i]-2*r)+m.pi*r*2)
        Ar.append(W[i]*H[i]-4*Acr)
else:
    print('You are doing something wrong')
Iy=Iytot
Iz=Iztot
# ---------- end python_11 ----------

# ---- group: Strength and stiffnes reduction factor
kmod_fire = PythonScript(t=time_of_exposure_7, Pr=python_11.Pr, Ar=python_11.Ar)  # -> out, Compression, Flexural, TensileShear; inputs Pr: list, Ar: list
# ---------- kmod_fire: Python ----------
C =[]
F = []
TS = []

for i in range(len(Pr)):
    if t<20:
        C.append(1-1/125*Pr[i]/Ar[i]*t/20)
        F.append(1-1/200*Pr[i]/Ar[i]*t/20)
        TS.append(1-1/330*Pr[i]/Ar[i]*t/20)
    else:
        C.append(1-1/125*Pr[i]/Ar[i])
        F.append(1-1/200*Pr[i]/Ar[i])
        TS.append(1-1/330*Pr[i]/Ar[i])
        
Compression = C
Flexural = F
TensileShear = TS
# ---------- end kmod_fire ----------

# ----
larger_2 = LargerThan(FirstNumber=width_3, SecondNumber=python_3.bmin)  # -> LargerThan, OrEqualTo
cull_6 = CullPattern(List=width_3, CullPattern=larger_2.LargerThan)
cull_7 = CullPattern(List=height_3, CullPattern=larger_2.LargerThan)
cull_8 = CullPattern(List=area_3, CullPattern=larger_2.LargerThan)
width_larger_than_bmin_2 = Data(cull_6)
height_larger_than_bmin_2 = Data(cull_7)
area_larger_than_bmin_2 = Data(cull_8)

# ---- group: Generates reduced width and height
# Calculates moment of inertia
python_12 = PythonScript(W=width_larger_than_bmin_2, H=height_larger_than_bmin_2, d=dchar, z=fire_exposed_sides_2)  # -> out, Width, Height; inputs W: list, H: list; same code as python_10

# ---- group: Uses reduced widht and height to calculate moment of inertia
python_13 = PythonScript(r=charring_depth, W=python_12.Width, H=python_12.Height, z=fire_exposed_sides_2)  # -> out, Iy, Iz, Pr, Ar; inputs W: list, H: list; same code as python_11

# ---- group: Strength and stiffnes reduction factor
kmod_fire_2 = PythonScript(t=time_of_exposure_9, Pr=python_13.Pr, Ar=python_13.Ar)  # -> out, Compression, Flexural, TensileShear; inputs Pr: list, Ar: list; same code as kmod_fire

# ----
iy_9 = Data(python_11.Iy)
iz_7 = Data(python_11.Iz)

# ---- group: Compression
multiplication_2 = Multiplication(A=kmod_fire.Compression, B=iy_9)
multiplication_3 = Multiplication(A=kmod_fire.Compression, B=iz_7)
iz_8 = Data(multiplication_3)
iy_10 = Data(multiplication_2)

# ---- group: Flexural
multiplication_4 = Multiplication(A=kmod_fire.Flexural, B=iy_9)
multiplication_5 = Multiplication(A=kmod_fire.Flexural, B=iz_7)
iz_9 = Data(multiplication_5)
iy_11 = Data(multiplication_4)

# ---- group: Tensile and Shear strength and stiffness factor
multiplication_6 = Multiplication(A=kmod_fire.TensileShear, B=iy_9)
multiplication_7 = Multiplication(A=kmod_fire.TensileShear, B=iz_7)
iz_10 = Data(multiplication_7)
iy_12 = Data(multiplication_6)

# ----
cluster_2 = Cluster(
    width_catalog=width_2,
    height_catalog=height_2,
    area=area_larger_than_bmin,
    required_moment_of_inertia=requried_moment_of_inertia_5,
    iy=iy_10,
    iz=iz_8)  # -> width_3, height_3
cluster_3 = Cluster(
    width_catalog=width_2,
    height_catalog=height_2,
    area=area_larger_than_bmin,
    required_moment_of_inertia=requried_moment_of_inertia_5,
    iy=iy_11,
    iz=iz_9)  # -> width_3, height_3
cluster_4 = Cluster(
    width_catalog=width_2,
    height_catalog=height_2,
    area=area_larger_than_bmin,
    required_moment_of_inertia=requried_moment_of_inertia_5,
    iy=iy_12,
    iz=iz_10)  # -> width_3, height_3

iy_13 = Data(python_13.Iy)
iz_11 = Data(python_13.Iz)

# ---- group: Compression
multiplication_8 = Multiplication(A=kmod_fire_2.Compression, B=iy_13)
multiplication_9 = Multiplication(A=kmod_fire_2.Compression, B=iz_11)
iz_12 = Data(multiplication_9)
iy_14 = Data(multiplication_8)

# ---- group: Flexural
multiplication_10 = Multiplication(A=kmod_fire_2.Flexural, B=iy_13)
multiplication_11 = Multiplication(A=kmod_fire_2.Flexural, B=iz_11)
iz_13 = Data(multiplication_11)
iy_15 = Data(multiplication_10)

# ---- group: Tensile and Shear strength and stiffness factor
multiplication_12 = Multiplication(A=kmod_fire_2.TensileShear, B=iy_13)
multiplication_13 = Multiplication(A=kmod_fire_2.TensileShear, B=iz_11)
iz_14 = Data(multiplication_13)
iy_16 = Data(multiplication_12)

# ----
cluster_5 = Cluster(
    width_catalog=width_3,
    height_catalog=height_3,
    area=area_larger_than_bmin_2,
    required_moment_of_inertia=requried_moment_of_inertia_6,
    iy=iy_14,
    iz=iz_12)  # -> width_3, height_3
cluster_6 = Cluster(
    width_catalog=width_3,
    height_catalog=height_3,
    area=area_larger_than_bmin_2,
    required_moment_of_inertia=requried_moment_of_inertia_6,
    iy=iy_15,
    iz=iz_13)  # -> width_3, height_3
cluster_7 = Cluster(
    width_catalog=width_3,
    height_catalog=height_3,
    area=area_larger_than_bmin_2,
    required_moment_of_inertia=requried_moment_of_inertia_6,
    iy=iy_16,
    iz=iz_14)  # -> width_3, height_3

# ==== cluster BeregningAfInertimomentExpression
centerline_for_column = ClusterInput()  # Input center line for column
strength_class_wood = ClusterInput()  # Strength class of wood for column
line = Line(centerline_for_column)
support_conditions = ClusterInput()  # Insert support conditions
load = ClusterInput()  # Critical vertical load
line_2 = Line(line)
len = Length(Curve=line_2)
num = Number(support_conditions)
num_2 = Number(strength_class_wood)
num_3 = Number(load)
multiplication = Multiplication(A=num, B=len)
expression = Expression(Ncr=num_3, E=num_2, ls=multiplication, Expression="(ls^2*Ncr)/(Pi^2*E)")
num_4 = Number(expression)
momen_of_inertia = ClusterOutput(num_4)  # Moment of inertia needed to take the given load

# ==== cluster BeregningAfInertimomentMedKomponenter
num = ClusterInput()
num_2 = ClusterInput()
line = ClusterInput()
num_3 = ClusterInput()
num_4 = Number(num)
num_5 = Number(num_2)
line_2 = Line(line)
num_6 = Number(num_3)
pi = Pi(Factor=1)
len = Length(Curve=line_2)
sqr = Square(Value=pi)
multiplication = Multiplication(A=num_6, B=len)
multiplication_2 = Multiplication(A=num_5, B=sqr)
sqr_2 = Square(Value=multiplication)
multiplication_3 = Multiplication(A=num_4, B=sqr_2)
division = Division(A=multiplication_3, B=multiplication_2)
num_7 = Number(division)
num_8 = ClusterOutput(num_7)

# ==== cluster Cluster
required_moment_of_inertia = ClusterInput()
iy = ClusterInput()
iz = ClusterInput()
required_moment_of_inertia_2 = Data(required_moment_of_inertia)
iy_2 = Data(iy)
iz_2 = Data(iz)
area = ClusterInput()
num = Number(required_moment_of_inertia_2)
num_2 = Number(iy_2)
num_3 = Number(iz_2)
python = PythonScript(I=num, Iy=num_2, Iz=num_3)  # -> out, PatternY, PatternZ; inputs Iy: list, Iz: list
# ---------- python: Python ----------
PatternY=[]
PatternZ=[]
#Creating boolean statement for capacity > needed
for i in Iy:
    PatternY.append(i>I)
#print(PatternY)
for i in Iz:
    PatternZ.append(i>I)
# ---------- end python ----------
area_2 = Data(area)
python_2 = PythonScript(x=python.PatternY, y=python.PatternZ)  # -> out, True, False; inputs x: list, y: list
# ---------- python_2: Python ----------
""" Combines two equal length lists of boolean statements
    to one, either dominated by true or false values
"""
T = []
F = []
for i in x:
    if i == 'True':
        T.append('True')
        F.append('True')
    else:
        T.append('False')
        F.append('False')

for i in range(len(y)):
    if y[i] == 'True':
        T[i]= 'True'

for i in range(len(y)):
    if y[i] == 'False':
        F[i]= 'False'

True=T
False=F
# ---------- end python_2 ----------
num_4 = Number(area_2)
cull = CullPattern(List=num_4, CullPattern=python_2.True)
bnd = Bounds(Numbers=cull)
num_5 = Number(num_4)
height_catalog = ClusterInput()
width_catalog = ClusterInput()
dedomain = DeconstructDomain(Domain=bnd)  # -> Start, End
mindex = MemberIndex(Set=num_5, Member=dedomain.Start)  # -> Index, Count
height_catalog_2 = Data(height_catalog)
width_catalog_2 = Data(width_catalog)
bnd_2 = Bounds(Numbers=mindex.Index)
num_6 = Number(width_catalog_2)
dedomain_2 = DeconstructDomain(Domain=bnd_2)  # -> Start, End
num_7 = Number(height_catalog_2)
num_8 = Number(num_5)
item = ListItem(List=num_8, Index=dedomain_2.Start, Wrap=True)
item_2 = ListItem(List=num_7, Index=dedomain_2.Start, Wrap=True)
item_3 = ListItem(List=num_6, Index=dedomain_2.Start, Wrap=True)
width = Data(item_3)
height = Data(item_2)
height_2 = Data(height)
width_2 = Data(width)
height_3 = ClusterOutput(height_2)
width_3 = ClusterOutput(width_2)
